# Grasshopper definition GH_MeshOffset_02_PF.gh (Grasshopper 1.0.7)
# plug-ins: Speckle 2, DendroGH, Pufferfish, Pancake

send = Send(AutoSend=False, CurrentComponentState="needs_input", KitName="Objects", UseDefaultCache=True, selectedKitName="Objects")  # disabled
mm = Panel("0.1")
pcimportobj = ImportOBJ(File="C:\Users\PFC\viktor-apps\viktor-grasshopper\input.obj", MapYtoZ=Button(), LastSaveLocalization="neutral,N")
mesh = Mesh(pcimportobj)
explode = ExplodeObject(Object=mesh, Recursive=False)
vsettings = CreateSettings(VoxelSize=0.1, Bandwidth=0.1, Isovalue=0, Adaptivity=0.1)
volume = Volume(mesh)
wrap = ShrinkWrap(Geometry=mesh, EdgeLength=mm, Offset=0, Smoothing=0, Optimization=10, FillHoles=True)
receive = Receive(
    Stream=<missing>,
    AutoReceive=False,
    CurrentComponentState="expired",
    ExpandOutput=True,
    ReceiveOnOpen=False,
    StreamWrapper="https://speckle.xyz/streams/724b722d6e",
    selectedKitName="Objects")  # -> Info, Data; disabled
mesh_2 = Mesh(<mesh referenced from the Rhino model>)  # disabled
mesh_3 = Mesh([<mesh referenced from the Rhino model> x1774])  # disabled
mesh_4 = Mesh([<mesh referenced from the Rhino model> x1199])  # disabled
vsettings_2 = CreateSettings(VoxelSize=1, Bandwidth=1, Isovalue=0, Adaptivity=0.1)  # disabled
medges = MeshEdges(Mesh=mesh_2)  # -> NakedEdges, InteriorEdges, NonManifoldEdges; disabled
mesh_5 = Mesh([<mesh referenced from the Rhino model> x1199])  # disabled
disjoint = DisjointMesh(Mesh=wrap)
vmesh = MeshToVolume(Mesh=mesh, Settings=vsettings)
panel = Panel("https://speckle.xyz/streams/724b722d6e")  # disabled
capex = CapHolesEx(Brep=mesh_4)  # -> Brep, Caps, Solid; disabled
voffset = OffsetVolume(Volume=vmesh, Distance="0.2")
panel_2 = Panel("0.1")  # disabled
vsettings_3 = VolumeSettings()  # disabled
crv = Curve(medges.NakedEdges)  # disabled
medges_2 = MeshEdges(Mesh=mesh_5)  # -> NakedEdges, InteriorEdges, NonManifoldEdges; disabled
area = Area(Geometry=disjoint)  # -> Area, Centroid
area_2 = Area(Geometry=mesh_3)  # -> Area, Centroid; disabled
vunion = VolumeUnion(Volumes=voffset)
panel_3 = Panel("0")  # disabled
wrap_2 = ShrinkWrap(Geometry=mesh_2, EdgeLength=panel_2, Offset=0, Smoothing=0, Optimization=10, FillHoles=True)  # disabled
vsettings_4 = CreateSettings(VoxelSize=0.2, Bandwidth=1, Isovalue=0, Adaptivity=0.1)  # disabled
mesh_6 = Mesh([<mesh referenced from the Rhino model> x5])  # disabled
sort = SortList(Keys=area.Area, ValuesA=disjoint)  # -> Keys, ValuesA
disjoint_2 = DisjointMesh(Mesh=wrap_2)  # disabled
panel_4 = Panel("0.5")  # disabled
panel_5 = Panel("0.6")  # disabled
lng = ListLength(List=medges_2.NonManifoldEdges)  # disabled
lng_2 = ListLength(List=medges_2.NakedEdges)  # disabled
rev = ReverseList(List=sort.ValuesA)
lng_3 = ListLength(List=medges_2.InteriorEdges)  # disabled
bbox = BoundingBox(Content=mesh_6, Plane=PlaneXY(0, 0, 0), UnionBox=True)  # -> Box, Box_2; disabled
area_3 = Area(Geometry=disjoint_2)  # -> Area, Centroid; disabled
vmesh_2 = MeshToVolume(Mesh=wrap_2, Settings=vsettings_4)  # disabled
item = ListItem(List=rev, Index=0, Wrap=True)
vmesh_3 = MeshToVolume(Mesh=mesh_5, Settings=vsettings_2)  # disabled
volume_2 = Volume(Geometry=bbox.Box)  # -> Volume, Centroid; disabled
voffset_2 = OffsetVolume(Volume=vmesh_2, Distance=expr("-x", panel_4))  # disabled
sort_2 = SortList(Keys=area_3.Area, ValuesA=disjoint_2)  # -> Keys, ValuesA; disabled
larger = LargerThan(FirstNumber=lng_2, SecondNumber=panel_3)  # -> LargerThan, OrEqualTo; disabled
larger_2 = LargerThan(FirstNumber=lng_3, SecondNumber=panel_3)  # -> LargerThan, OrEqualTo; disabled
larger_3 = LargerThan(FirstNumber=lng, SecondNumber=panel_3)  # -> LargerThan, OrEqualTo; disabled
addition = Addition(A=panel_4, B=panel_5)  # disabled
vunion_2 = VolumeUnion(Volumes=vmesh_3)  # disabled
vsettings_5 = CreateSettings(VoxelSize=0.2, Bandwidth=1, Isovalue=0, Adaptivity=0.1)
rev_2 = ReverseList(List=sort_2.ValuesA)  # disabled
mm_2 = Panel(".6")
mm_3 = Panel(".5")
voffset_3 = OffsetVolume(Volume=voffset_2, Distance=addition)  # disabled
msphere = MeshSphere(Base=volume_2.Centroid, Radius=10, UCount=10, VCount=20)  # disabled
item_2 = ListItem(List=rev_2, Index=0, Wrap=True)  # disabled
offmsh = OffsetMesh(Mesh=item_2, Distance=expr("x", panel_4), BothSides=0, CreateSolid=True)  # disabled
offmsh_2 = OffsetMesh(Mesh=offmsh, Distance=expr("-x", addition), BothSides=0, CreateSolid=True)  # disabled
multiplication = Multiplication()  # disabled
vmesh_4 = MeshToVolume(Mesh=item, Settings=vsettings_5)
minc = MeshInclusion(Mesh=voffset_3, Point=area_2.Centroid, Strict=False)  # disabled
facen = FaceNormals(Mesh=msphere)  # -> Centers, Normals; disabled
exposure = Exposure(Shape=mesh_6, Rays=facen.Normals, Lambert=False)  # -> Exposure, Range; disabled
mcol = MeshColours(Mesh=mesh_6, Colours=flatten(exposure.Exposure))  # disabled
voffset_4 = OffsetVolume(Volume=vmesh_4, Distance=expr("-x", mm_3))
addition_2 = Addition(A=larger.LargerThan, B=larger_3.LargerThan)  # disabled
panel_6 = Panel(addition_2)  # disabled
addition_3 = Addition(A=mm_3, B=mm_2)
meshcp = MeshClosestPoint(Point=area_2.Centroid, Mesh=mesh_3)  # -> Point, Index, Parameter; disabled
dist = Distance(PointA=area_2.Centroid, PointB=meshcp.Point)  # disabled
panel_7 = Panel("0.3")  # disabled
cull = CullPattern(List=area_2.Centroid, CullPattern=invert(minc))  # disabled
voffset_5 = OffsetVolume(Volume=voffset_4, Distance=addition_3)
panel_8 = Panel(exposure.Exposure)  # disabled
larger_4 = LargerThan(FirstNumber=dist, SecondNumber=panel_7)  # -> LargerThan, OrEqualTo; disabled
area_4 = Area(Geometry=explode)  # -> Area, Centroid
cull_2 = CullPattern(List=mesh_5, CullPattern=invert(flatten(addition_2)))  # disabled
cull_3 = CullPattern(List=mesh_3, CullPattern=invert(minc))  # disabled
cull_4 = CullPattern(List=mesh_3, CullPattern=minc)  # disabled
minc_2 = MeshInclusion(Mesh=voffset_5, Point=area_4.Centroid, Strict=False)
area_5 = Area(Geometry=cull_3)  # -> Area, Centroid; disabled
meshcp_2 = MeshClosestPoint(Point=area_5.Centroid, Mesh=mesh_3)  # -> Point, Index, Parameter; disabled
panel_9 = Panel("green")  # disabled
panel_10 = Panel("red")  # disabled
cull_5 = CullPattern(List=explode, CullPattern=invert(minc_2))
cull_6 = CullPattern(List=explode, CullPattern=minc_2)
dist_2 = Distance(PointA=area_2.Centroid, PointB=meshcp_2.Point)  # disabled
pcattribute = Attribute(
    Color=ColourSwatch(SwatchColor=RGB(0, 255, 51)),
    CurrentInputVisibility=0,
    CurrentOutputVisibility=0,
    LastSaveLocalization="neutral,N")
preview = CustomPreview(Geometry=cull_4, Material=panel_9)  # disabled
preview_2 = CustomPreview(Geometry=cull_3, Material=panel_10)  # disabled
pcattribute_2 = Attribute(
    Color=ColourSwatch(SwatchColor=RGB(255, 0, 0)),
    CurrentInputVisibility=0,
    CurrentOutputVisibility=0,
    LastSaveLocalization="neutral,N")
panel_11 = Panel("0.3")  # disabled
lng_4 = ListLength(List=flatten(cull_6))
lng_5 = ListLength(List=flatten(cull_5))
larger_5 = LargerThan(FirstNumber=dist_2, SecondNumber=panel_11)  # -> LargerThan, OrEqualTo; disabled
truebutton = TrueOnlyButton(LastSaveLocalization="neutral,N")
repeat = RepeatData(Data=pcattribute_2, Length=lng_4)
repeat_2 = RepeatData(Data=pcattribute, Length=lng_5)
cull_7 = CullPattern(List=cull_3, CullPattern=larger_5.LargerThan)  # disabled
merge = Merge(Data1=flatten(cull_5), Data2=flatten(cull_6))
merge_2 = Merge(Data1=flatten(repeat_2), Data2=flatten(repeat))
pcexport3dm = Export3DM(
    Geometry=merge,
    Layer="Default",
    ObjectAttributes=merge_2,
    FileLocation="C:\Users\PFC\viktor-apps\viktor-grasshopper\output.3dm",
    Overwrite=Toggle(True),
    Version=0,
    Export=Button(),
    LastSaveLocalization="neutral,N")  # -> OK, Log
